# Dynamo graph 1.Sheetselection.dyn (Dynamo 3.2.1.5366)

# group: SELECT AND SORT THE SHEETS
get_selected_sheets = Python()  # CPython3
# ---------- get_selected_sheets.python (61 lines) ----------
#clr stands for Common Language Runtmie. Allows Dynamo to interact with Revit. 
import clr

#We are now importing the Revit API Dynamo has to interact with. It contains all the elements we can interact with. 
#By using * we are importing EVERYTHING from the database namespace (classes, methods, etc) used to work with the actual revit model. 
clr.AddReference('RevitAPI')
from Autodesk.Revit.DB import *
from Autodesk.Revit.DB.Structure import *

#The following contains tools for interacting with revits User Interface. Like selecting elements. 
clr.AddReference('RevitAPIUI')
from Autodesk.Revit.UI import *

#Importing general system libraries with basic programming utilities
clr.AddReference('System')


#Importing the class list. They can only contain one type of object. In revit you often need .NET types instead of Python types. 
from System.Collections.Generic import List

clr.AddReference('RevitNodes')
import Revit
clr.ImportExtensions(Revit.GeometryConversion)
clr.ImportExtensions(Revit.Elements)

#importing RevitServices, a library used by dynamo to manage interactions with revit more easily. 
clr.AddReference('RevitServices')
import RevitServices

#document manager is a helper class that gives you easy access to the revit document you are working on. 
from RevitServices.Persistence import DocumentManager

#transaction manager handles a safe space where you can make changes. 
from RevitServices.Transactions import TransactionManager

#save current document in a variable. This contains all the revit elements, views and data. It is needed to modify the model. 
doc = DocumentManager.Instance.CurrentDBDocument

#This also relates to the current document. Not to its elements, but how you interact with the interface. Like, what is the current view, what elements are selected, etc. 
uidoc=DocumentManager.Instance.CurrentUIApplication.ActiveUIDocument


#Do some action in a Transaction
TransactionManager.Instance.EnsureInTransaction(doc)


#We store the selected items in a variable called selection by using the ids. 
selection=uidoc.Selection.GetElementIds()

#Then, we create and empty list to store the output. 
output=[]

#We populate our list with the selected content. 
for s in selection: 
    output.append(doc.GetElement(s).ToDSType(True))
    
OUTPUT=output

TransactionManager.Instance.TransactionTaskDone()

OUT = output
# ----------------------------------------
sheetNumber = Sheet.SheetNumber()  # unwired: sheet
sortByFunction = List.SortByFunction(list=get_selected_sheets, sortFunction=sheetNumber)

start = Revit.Transaction.Transaction.Start(input=sortByFunction)

# group: GIVE SHEETS A PROVISIONAL NUMBER
code_block = CodeBlock { "Sheet Number"; }
code_block_2 = CodeBlock { "A"; }
code_block_3 = CodeBlock { 101..113; }
code_block_4 = CodeBlock { "#"; }
code_block_5 = CodeBlock(a=code_block_2, b=code_block_3, c=code_block_4) { a+b+c; }
setParameterByName = Element.SetParameterByName(element=start, parameterName=code_block, value=code_block_5)

end = Revit.Transaction.Transaction.End(input=setParameterByName)

# group: CHECK
code_block_6 = CodeBlock { "Sheet Number"; }
getParameterValueByName = Element.GetParameterValueByName(element=end, parameterName=code_block_6)

# group: GIVE SHEETS THEIR DEFINITE NUMBER
code_block_7 = CodeBlock { "Sheet Number"; }
code_block_8 = CodeBlock { "#"; }
code_block_9 = CodeBlock { ""; }
replace = String.Replace(string=getParameterValueByName, searchFor=code_block_8, replaceWith=code_block_9)
setParameterByName_2 = Element.SetParameterByName(element=end, parameterName=code_block_7, value=replace)
getParameterValueByName_2 = Element.GetParameterValueByName(element=setParameterByName_2, parameterName=code_block_7)
